# Grasshopper definition slicer.gh (Grasshopper 1.0.7)

outer = Slider(20, range=20..40)
points = Slider(24, range=10..30)
inner = Slider(6, range=1..10)
python = GhPythonScript(inner_radius=inner, outer_radius=outer, num_points=points)  # -> curve, points
# ---------- python: Python ----------
import math
import random
import rhinoscriptsyntax as rs

points = []
for p in range(int(num_points)):
    theta = p * (2 * math.pi / num_points)
    length = inner_radius + (random.random() * (outer_radius - inner_radius))
    x = length*math.cos(theta)
    y = length*math.sin(theta)
    points.append(rs.AddPoint([x, y, 0]))

points.append(points[0])
# ---------- end python ----------
trigger = Trigger(Interval=-1000, TimerInterval=1000, Target=python_2)
vec = VectorXYZ(XComponent=0, YComponent=0, ZComponent=Slider(6, range=1..10))  # -> Vector, Length
intcrv = Interpolate(Vertices=python.points, Degree=3, Periodic=False, KnotStyle=1)  # -> Curve, Length, Domain
crv = Curve(<curve referenced from the Rhino model>)
extr = Extrude(Base=intcrv.Curve, Direction=vec.Vector)
python_2 = GhPythonScript()  # -> out, file
# ---------- python_2: Python ----------
import rhinoscriptsyntax as rs

filter = "GCode (*.gcode)|*.gcode|All Files (*.*)|*.*||"
file = rs.SaveFileName("", filter)
# ---------- end python_2 ----------
geo = Geometry(<brep referenced from the Rhino model>)
cap = CapHoles(Brep=extr)
dam = DataDam(DataB=Slider(3, range=0..20), DataA=geo, BufferDelay=10000000, BufferMode=0)  # -> DataB, DataA
dam_2 = DataDam(DataA=python_2.file, BufferDelay=10000000, BufferMode=0)
python_3 = GhPythonScript(filename=dam_2, layer=dam.DataB, shape=dam.DataA)  # -> out, lines, turtle, travel; inputs shape: Brep
# ---------- python_3: Python ----------
# code required so that library reloads appropriately
# must be above other import statements
import sys
import math
import time
import operator as op
to_delete = list()
for module in sys.modules:
    if "slicing_utils" in module:
      to_delete.append(module)
    if "extruder_turtle" in module:
      to_delete.append(module)
    if "turtle_utilities" in module:
      to_delete.append(module)
for module in to_delete:
    sys.modules.pop(module)

import slicing_utils
from slicing_utils import *

import extruder_turtle
from extruder_turtle import *

import turtle_utilities as tu

import Rhino
import rhinoscriptsyntax as rs

reload(slicing_utils)
reload(extruder_turtle)


# Main code
# set up the turtle
t = ExtruderTurtle()
t.setup(filename=filename, printer = "eazao")
t.set_extrude_width(0.84)
print("standard layer height is: " +str(t.get_layer_height()))
print("standard extrusion width is: "+str(t.get_extrude_width()))

# draw
#travel = slice_fermat_fill(t, shape, wall_mode=True, walls=2, fill_bottom=True, bottom_layers=2)
#travel = slice_spiral_fill(t, shape)
#travel = slice_contour_fill(t, shape)

layer = 3
root = fill_layer_with_fermat_spiral(t, shape, layer*t.get_layer_height())

#isocontours = contours[1]
#points = [rs.DivideCurve(curve, 100) for curve in isocontours]
#inside = {c:{c2:all([rs.PointInPlanarClosedCurve(p, isocontours[c]) for p in points[c2]]) for c2 in range(len(isocontours)) if c2 != c} for c in range(len(isocontours))}
#index_out = 0
#index_in = 1
#print(directly_inside(index_out, index_in, inside))
#travel = [isocontours[index_out], isocontours[index_in]]

travel = [
    root['children'][0]['guid'],
    root['children'][0]['children'][0]['guid'],
    root['children'][1]['guid'],
    root['children'][1]['children'][0]['guid'],
    root['children'][1]['children'][1]['guid'],
    root['children'][1]['children'][1]['children'][0]['guid'],
    root['children'][1]['children'][1]['children'][0]['children'][0]['guid'],
    root['children'][1]['children'][1]['children'][0]['children'][0]['children'][0]['guid'],
    root['children'][1]['children'][1]['children'][0]['children'][0]['children'][0]['children'][0]['guid'],
    root['children'][1]['children'][1]['children'][0]['children'][0]['children'][0]['children'][0]['children'][0]['guid'],
    root['children'][1]['children'][1]['children'][0]['children'][0]['children'][0]['children'][0]['children'][0]['children'][0]['guid'],
]

# visualize the turtle's path
#turtle = t.draw_turtle()
lines = t.get_lines()

# close the generated .gcode file
t.finish()
# ---------- end python_3 ----------
crv_2 = Curve(python_3.travel)
crv_3 = Curve(python_3.lines)
join = JoinCurves(Curves=python_3.lines, Preserve=False)
divide = DivideCurve(Curve=join, Count=Slider(500, range=0..1000), Kinks=False)  # -> flatten(Points), Tangents, Parameters
dom = ConstructDomain(DomainStart=0, DomainEnd=Slider(10000, range=0..10000))
panel = Panel(divide.Points)
subset = SubList(List=divide.Points, Domain=dom, Wrap=True)  # -> List, Index
intcrv_2 = Interpolate(Vertices=subset.List, Degree=3, Periodic=False, KnotStyle=1)  # -> Curve, Length, Domain
